# Grasshopper definition Test.gh (Grasshopper 0.9.75)
# plug-ins: Python Interpreter

honeybee = Honeybee_Honeybee()  # -> Vviiiiiiiiiizzz; plug-in component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
ladybug = Ladybug_Ladybug()  # -> Vviiiiiiiiiizzz; plug-in component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
panel = Panel("C:\git\NoeValleyWFM_EnergyModel\NoeValleyWFM\SuperceededVersions\Testing\NoeValleyWFM_test5.idf")
importidf = Honeybee_ImportIdf(idfFile=panel, importEPObjects=Toggle(False))  # -> readMe, HBZones, shadings; plug-in component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
panel_2 = Panel(importidf.readMe)
solveadjc = Honeybee_SolveAdjacencies(HBZones=flatten(importidf.HBZones), removeCurrentAdjc=False, findAdjc=Toggle(False))  # -> readMe, HBZonesWADJ; plug-in component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
panel_3 = Panel(solveadjc.readMe)
